# Dynamo graph PDFexport.dyn (Dynamo 2.19.3.6394)
# packages: Orchid 2.19.5.6567

# group: Merge PDF files
code_block = CodeBlock()
# ---------- code_block.designscript (6 lines) ----------
//input documents
["C:\\Users\\Public\\Temp\\pdf\\pdf1.pdf",
"C:\\Users\\Public\\Temp\\pdf\\pdf2.pdf"];

//output file path
"C:\\Users\\Public\\Temp\\pdf\\result.pdf";
# ----------------------------------------
mergePDF = Orchid.Common.File.MergePDF(documents=code_block.out0, filePath=code_block.out1)  # frozen

# group: Export to PDF
sheet_set = SheetSet("A3 set")  # graph input
boolean = BoolSelector(false)  # graph input
name = Orchid.RevitProject.Common.Document.Name()
pdfexport_quality = ExportQuality("DPI1200")
byViewSheetSet = Orchid.Revit.Common.PDFexport.ByViewSheetSet(viewSheetSet=sheet_set, combine=boolean, fileName=name, exportQuality=pdfexport_quality)
view = Orchid.RevitProject.Views.SheetSet.View(viewSheetSet=sheet_set)
byView = Orchid.Revit.Common.PDFexport.ByView(view=view, combine=boolean, fileName=name)  # frozen

# group: SheetSet
code_block_2 = CodeBlock { "Sheets"; }  # frozen
byName = Category.ByName(name=code_block_2)
all_elements_of_category = ElementsOfCategory(Category=byName)
string = StringInput("testSet")  # graph input
create = Orchid.RevitProject.Views.SheetSet.Create(view=all_elements_of_category, name=string)
delete = Orchid.RevitProject.Views.SheetSet.Delete(viewSheetSet=create)  # frozen
view_2 = Orchid.RevitProject.Views.SheetSet.View(viewSheetSet=create)
sheet_set_2 = SheetSet("A3 set")  # graph input
change = Orchid.RevitProject.Views.SheetSet.Change(view=view_2, viewSheetSet=sheet_set_2)

# group: Print current view (center and fit to page)
string_2 = StringInput("testSetting2")  # graph input; frozen
pdfexport_paper_sizes = PaperSize("<Use Sheet Size>")
print_paper_placement = PaperPlacement("Center")  # graph input
print_zoom_type = ZoomType("Fit To Page")  # graph input
createSetting = Orchid.Revit.Common.PDFexport.CreateSetting(name=string_2, paperZize=pdfexport_paper_sizes, paperPlacement=print_paper_placement, zoomType=print_zoom_type)
activeView = Orchid.RevitProject.Common.Document.ActiveView()
# note: if export options there are rarely set need to be included, then connect:
# "Export.SetOptions" output ExportSetting to "Export.ByView" input exportSetting!
byView_2 = Orchid.Revit.Common.PDFexport.ByView(pathName=activeView, exportSetting=createSetting)
await_ = Orchid.Common.DataStream.Await(pass=createSetting, waitFors=byView_2)
delete_2 = Orchid.RevitProject.Elements.Element.Delete(element=await_)

# group: Print options there are rarely set
boolean_2 = BoolSelector(true)  # graph input
boolean_3 = BoolSelector(false)  # graph input
print_raster_quality = RasterQuality("Medium")
print_color_depth = ColorDepthType("Gray Scale")  # graph input
setOptions = Orchid.Revit.Common.PDFexport.SetOptions(exportSetting=createSetting, viewLinksinBlue=boolean_2, hideReforWorkPlanes=boolean_3, hideUnreferencedViewTags=boolean_2, maskCoincidentLines=boolean_2, hideScopeBoxes=boolean_3, hideCropBoundaries=boolean_3, replaceHalftoneWithThinLines=boolean_2, createOutputUsing=boolean_2, rasterQuality=print_raster_quality, colorDepth=print_color_depth)  # frozen

string_3 = StringInput("testSetting")  # graph input
createSetting_2 = Orchid.Revit.Common.PDFexport.CreateSetting(name=string_3)
pdfexport_paper_sizes_2 = PaperSize("ISO A3 : 297x420 mm")
print_page_orientation = PageOrientation("Portrait")  # graph input
print_paper_placement_2 = PaperPlacement("Lower Left")  # graph input
print_margin_type = MarginType("User defined")  # graph input
code_block_3 = CodeBlock { [10,10]; }
print_zoom_type_2 = ZoomType("Zoom")  # graph input
code_block_4 = CodeBlock { 100; }
changeSetting = Orchid.Revit.Common.PDFexport.ChangeSetting(exportSetting=createSetting_2, paperZize=pdfexport_paper_sizes_2, pageOrientation=print_page_orientation, paperPlacement=print_paper_placement_2, marginType=print_margin_type, margin=code_block_3, zoomType=print_zoom_type_2, zoom=code_block_4)  # frozen

# group: Remove print setting
string_4 = StringInput("testSetting")  # graph input
byName_2 = Orchid.Revit.Common.PDFexport.ByName(name=string_4)
watch = Watch(byName_2)
pdfexport_settings = Setting("testSetting")
delete_3 = Orchid.RevitProject.Elements.Element.Delete(element=byName_2)  # frozen

paperSize = Orchid.Revit.Common.PDFexport.PaperSize()
watch_2 = Watch(paperSize)
