# Dynamo graph Revit Application.dyn (Dynamo 2.19.3.6394)
# packages: Orchid 2.19.3.6432

username = Orchid.AdeskApp.Revit.Username()
watch = Watch(username)

# group: Application
format = Orchid.AdeskApp.Revit.Format()
watch_2 = Watch(format)
applicationFolder = Orchid.AdeskApp.Revit.ApplicationFolder()
watch_3 = Watch(applicationFolder)

# group: Version
versionBuild = Orchid.AdeskApp.Revit.VersionBuild()
watch_4 = Watch(versionBuild)
version = Orchid.AdeskApp.Revit.Version()
watch_5 = Watch(version)

culture = Orchid.AdeskApp.Revit.Culture()
watch_6 = Watch(culture)
language = Orchid.AdeskApp.Revit.Language()
watch_7 = Watch(language)
