# Dynamo graph Form.dyn "Form_R23" (Dynamo 2.16.2.5624)
# packages: Orchid 216.3.0.5799

# group: 
# File: 3solid.rfa (Geometry folder)
element_classes = ElementTypes("Extrusion")
all_elements_of_class = ElementsOfType(element_class=element_classes)
solids = Element.Solids(element=all_elements_of_class)
watch = Watch(solids)
solid = Orchid.Geometry.Form.Solid(form=all_elements_of_class)
watch_2 = Watch(solid)
element_classes_2 = ElementTypes("FreeFormElement")

# group: Dynamo Solid
get = Orchid.Geometry.Form.Get()
solid_2 = Orchid.Geometry.Form.Solid(form=get)
watch_3 = Watch(solid_2)
intersect = Orchid.Geometry.Solid.Intersect(solid=solid_2)
watch_4 = Watch(intersect)
byUnion = Solid.ByUnion(solids=solid_2)
area = Solid.Area(solid=byUnion)
watch_5 = Watch(area)
volume = Solid.Volume(solid=byUnion)
watch_6 = Watch(volume)
watch_7 = Watch(byUnion)
toOrchidType = Orchid.Geometry.Solid.ToOrchidType(solid=byUnion)
watch_8 = Watch(toOrchidType)

# group: Orchid Solid
get_2 = Orchid.Geometry.Form.Get()
ocSolid = Orchid.Geometry.Form.OcSolid(form=get_2)
intersect_2 = Orchid.Geometry.OcSolid.Intersect(ocSolid=ocSolid)
watch_9 = Watch(intersect_2)
watch_10 = Watch(ocSolid)
union = Orchid.Geometry.OcSolid.Union(ocSolid=ocSolid)
area_2 = Orchid.Geometry.OcSolid.Area(ocSolid=union)
watch_11 = Watch(area_2)
volumne = Orchid.Geometry.OcSolid.Volumne(ocSolid=union)
watch_12 = Watch(volumne)
watch_13 = Watch(union)
toDynamoType = Orchid.Geometry.OcSolid.ToDynamoType(ocSolid=union)
watch_14 = Watch(toDynamoType)
