# Dynamo graph Group.dyn (Dynamo 2.19.3.6394)
# packages: Orchid 2.19.5.6567

# group: Create group
# File: defaultProject
code_block = CodeBlock()
# ---------- code_block.designscript (11 lines) ----------
"CategoryType";

"Model";
"Annotation";
"AnalyticalModel";
"Internal";

["Model",
"Annotation",
"AnalyticalModel",
"Internal"];
# ----------------------------------------
enumByName = Orchid.AdeskApps.Revit.EnumByName(enumType=code_block.out0, valueName=code_block.out1)
byCategoryType = Orchid.RevitProject.Elements.Element.ByCategoryType(categoryType=enumByName)
watch = Watch(byCategoryType.Element)
code_block_2 = CodeBlock { "test"; }
flatten = List.Flatten(list=byCategoryType.Element)
create = Orchid.Revit.Common.Group.Create(name=code_block_2, element=flatten)

# group: Group delete
code_block_3 = CodeBlock { "test"; }
byName = Orchid.Revit.Common.Group.ByName(name=code_block_3)
delete = Orchid.RevitProject.Elements.Element.Delete(element=byName)  # frozen
groups = Group("test")

# group: GroupType delete
group_types = GroupType("test")
code_block_4 = CodeBlock { "test"; }
byName_2 = Orchid.Revit.Common.GroupType.ByName(name=code_block_4)
delete_2 = Orchid.RevitProject.Elements.Element.Delete(element=byName_2)  # frozen

# group: Group ungroup
groups_2 = Group("test")
code_block_5 = CodeBlock { "test"; }
byName_3 = Orchid.Revit.Common.Group.ByName(name=code_block_5)
unGroup = Orchid.Revit.Common.Group.UnGroup(group=byName_3)
